# Grasshopper definition robot_model_export.gh (Grasshopper 1.0.7)

image_sampler = ImageSampler(FilePath="C:\Users\leungp\Desktop\joint.png", Filter="Colour", Interpolate=False, Umax=1, Umin=0, Vmax=1, Vmin=0, Wrap=1)
image_sampler_2 = ImageSampler(
    FilePath="C:\Users\leungp\Desktop\inertial.png",
    Filter="Colour",
    Interpolate=False,
    Umax=1,
    Umin=0,
    Vmax=1,
    Vmin=0,
    Wrap=1)

mesh = Mesh(<mesh referenced from the Rhino model>)
point = Point(<point referenced from the Rhino model>)
xy_plane = XYPlane(Origin=point)
link = GhPythonScript(collision_meshes=mesh, visual_meshes=mesh, link_name="link_6", origin=xy_plane)  # -> out, link; inputs collision_meshes: list of Mesh, visual_meshes: list of Mesh, origin: Plane
# ---------- link: Python ----------
"""Provides a scripting component.
    Inputs:
        collision_meshes: The collision meshes for the link
        visual_meshes: The visual meshes for the link
        link_name: The y script variable
        origin: The Plane that describes the origin of the link.
    Output:
        link: The new compas robots Link object"""

__author__ = "leungp"
__version__ = "2024.10.10"

import rhinoscriptsyntax as rs
from compas.geometry import Transformation
from compas_robots.model import Link
from compas_robots.model import LinkGeometry
from compas_robots.model import MeshDescriptor

from compas_robots.model import Visual
from compas_robots.model import Collision
from compas_rhino.conversions import mesh_to_compas
from compas_rhino.conversions import plane_to_compas_frame

assert collision_meshes
assert visual_meshes

if origin:
    origin = plane_to_compas_frame(origin)
    transformation = Transformation.from_frame(origin).inverse()
    print("Meshes Transformed by {}".format(transformation))

visuals = []
for m in visual_meshes:
    visual = Visual(LinkGeometry(MeshDescriptor("")))
    cm = mesh_to_compas(m)
    if origin:
        cm.transform(transformation)
    visual.geometry.shape.meshes = [cm]
    visuals.append(visual)

collisions = []
for m in collision_meshes:
    collision = Collision(LinkGeometry(MeshDescriptor("")))
    cm = mesh_to_compas(m)
    if origin:
        cm.transform(transformation)
    collision.geometry.shape.meshes = [cm]
    collisions.append(collision)

link = Link(name=link_name, visual = visuals, collision = collisions)
# ---------- end link ----------

mesh_2 = Mesh(<mesh referenced from the Rhino model>)
point_2 = Point(<point referenced from the Rhino model>)
xy_plane_2 = XYPlane(Origin=point_2)
link_2 = GhPythonScript(collision_meshes=mesh_2, visual_meshes=mesh_2, link_name="link_5", origin=xy_plane_2)  # -> out, link; inputs collision_meshes: list of Mesh, visual_meshes: list of Mesh, origin: Plane; same code as link

mesh_3 = Mesh(<mesh referenced from the Rhino model>)
point_3 = Point(<point referenced from the Rhino model>)
xy_plane_3 = XYPlane(Origin=point_3)
link_3 = GhPythonScript(collision_meshes=mesh_3, visual_meshes=mesh_3, link_name="link_3", origin=xy_plane_3)  # -> out, link; inputs collision_meshes: list of Mesh, visual_meshes: list of Mesh, origin: Plane; same code as link

mesh_4 = Mesh(<mesh referenced from the Rhino model>)
point_4 = Point(<point referenced from the Rhino model>)
link_4 = GhPythonScript(collision_meshes=mesh_4, visual_meshes=mesh_4, link_name="base_link", origin=point_4)  # -> out, link; inputs collision_meshes: list of Mesh, visual_meshes: list of Mesh, origin: Plane; same code as link

point_5 = Point(<point referenced from the Rhino model>)
mesh_5 = Mesh(<mesh referenced from the Rhino model>)
xy_plane_4 = XYPlane(Origin=point_5)
link_5 = GhPythonScript(collision_meshes=mesh_5, visual_meshes=mesh_5, link_name="link_1", origin=xy_plane_4)  # -> out, link; inputs collision_meshes: list of Mesh, visual_meshes: list of Mesh, origin: Plane; same code as link

mesh_6 = Mesh(<mesh referenced from the Rhino model>)
point_6 = Point(<point referenced from the Rhino model>)
xy_plane_5 = XYPlane(Origin=point_6)
link_6 = GhPythonScript(collision_meshes=mesh_6, visual_meshes=mesh_6, link_name="link_2", origin=xy_plane_5)  # -> out, link; inputs collision_meshes: list of Mesh, visual_meshes: list of Mesh, origin: Plane; same code as link

mesh_7 = Mesh(<mesh referenced from the Rhino model>)
point_7 = Point(<point referenced from the Rhino model>)
xy_plane_6 = XYPlane(Origin=point_7)
link_7 = GhPythonScript(collision_meshes=mesh_7, visual_meshes=mesh_7, link_name="link_4", origin=xy_plane_6)  # -> out, link; inputs collision_meshes: list of Mesh, visual_meshes: list of Mesh, origin: Plane; same code as link

supported_types = ValueList({"REVOLUTE": 0, "CONTINUOUS": 1, "PRISMATIC": 2, "FIXED": 3, "FLOATING": 4, "PLANAR": 5}, selected="REVOLUTE")
curve = Curve(<curve referenced from the Rhino model>)
end_points = EndPoints(Curve=curve)  # -> Start, End
vector_2pt = Vector2Pt(PointA=end_points.Start, PointB=end_points.End, Unitize=False)  # -> Vector, Length
radians = Radians(Degrees=Slider(270, range=0..1000))
radians_2 = Radians(Degrees=Slider(-270, range=-1000..1000))
joint = GhPythonScript(
    name="joint_1",
    type=supported_types,
    origin=end_points.Start,
    axis=vector_2pt.Vector,
    parent_link=link_4.link,
    child_link=link_5.link,
    lower_limit=radians_2,
    upper_limit=radians)  # -> out, joint; inputs type: Int32, origin: Plane, axis: Vector3d
# ---------- joint: Python ----------
__author__ = "leungp"
__version__ = "2024.10.10"

import rhinoscriptsyntax as rs
from compas_robots.model import Joint
from compas_robots.model import Limit
from compas_robots.model import Axis

from compas_rhino.conversions import plane_to_compas_frame
from compas_rhino.conversions import vector_to_compas

axis = vector_to_compas(axis).unitized()
urdf_axis = Axis()
urdf_axis.x = axis.x
urdf_axis.y = axis.y
urdf_axis.z = axis.z

parent = parent_link.name if hasattr(parent_link, 'name') else str(parent_link)
child = child_link.name if hasattr(child_link, 'name') else str(child_link)

joint = Joint(
    name = name,
    type = type,
    parent = parent,
    child = child, 
    origin = plane_to_compas_frame(origin), 
    axis = urdf_axis,
    limit = Limit(lower = lower_limit, upper = upper_limit),
    )
# ---------- end joint ----------

supported_types_2 = ValueList({"REVOLUTE": 0, "CONTINUOUS": 1, "PRISMATIC": 2, "FIXED": 3, "FLOATING": 4, "PLANAR": 5}, selected="REVOLUTE")
curve_2 = Curve(<curve referenced from the Rhino model>)
orient = Orient(Geometry=curve_2, Source=xy_plane_4, Target=PlaneXY(0, 0, 0))  # -> Geometry, Transform
radians_3 = Radians(Degrees=Slider(180, range=0..1000))
radians_4 = Radians(Degrees=Slider(-180, range=-1000..1000))
end_points_2 = EndPoints(Curve=orient.Geometry)  # -> Start, End
vector_2pt_2 = Vector2Pt(PointA=end_points_2.Start, PointB=end_points_2.End, Unitize=False)  # -> Vector, Length
joint_2 = GhPythonScript(
    name="joint_2",
    type=supported_types_2,
    origin=end_points_2.Start,
    axis=vector_2pt_2.Vector,
    parent_link=link_5.link,
    child_link=link_6.link,
    lower_limit=radians_4,
    upper_limit=radians_3)  # -> out, joint; inputs type: Int32, origin: Plane, axis: Vector3d; same code as joint

supported_types_3 = ValueList({"REVOLUTE": 0, "CONTINUOUS": 1, "PRISMATIC": 2, "FIXED": 3, "FLOATING": 4, "PLANAR": 5}, selected="REVOLUTE")
curve_3 = Curve(<curve referenced from the Rhino model>)
orient_2 = Orient(Geometry=curve_3, Source=xy_plane_6, Target=PlaneXY(0, 0, 0))  # -> Geometry, Transform
radians_5 = Radians(Degrees=Slider(180, range=0..1000))
radians_6 = Radians(Degrees=Slider(-180, range=-1000..1000))
end_points_3 = EndPoints(Curve=orient_2.Geometry)  # -> Start, End
vector_2pt_3 = Vector2Pt(PointA=end_points_3.Start, PointB=end_points_3.End, Unitize=False)  # -> Vector, Length
joint_3 = GhPythonScript(
    name="joint_5",
    type=supported_types_3,
    origin=end_points_3.Start,
    axis=vector_2pt_3.Vector,
    parent_link=link_7.link,
    child_link=link_2.link,
    lower_limit=radians_6,
    upper_limit=radians_5)  # -> out, joint; inputs type: Int32, origin: Plane, axis: Vector3d; same code as joint

supported_types_4 = ValueList({"REVOLUTE": 0, "CONTINUOUS": 1, "PRISMATIC": 2, "FIXED": 3, "FLOATING": 4, "PLANAR": 5}, selected="REVOLUTE")
curve_4 = Curve(<curve referenced from the Rhino model>)
orient_3 = Orient(Geometry=curve_4, Source=xy_plane_3, Target=PlaneXY(0, 0, 0))  # -> Geometry, Transform
radians_7 = Radians(Degrees=Slider(180, range=0..1000))
radians_8 = Radians(Degrees=Slider(-180, range=-1000..1000))
end_points_4 = EndPoints(Curve=orient_3.Geometry)  # -> Start, End
vector_2pt_4 = Vector2Pt(PointA=end_points_4.Start, PointB=end_points_4.End, Unitize=False)  # -> Vector, Length
joint_4 = GhPythonScript(
    name="joint_4",
    type=supported_types_4,
    origin=end_points_4.Start,
    axis=vector_2pt_4.Vector,
    parent_link=link_3.link,
    child_link=link_7.link,
    lower_limit=radians_8,
    upper_limit=radians_7)  # -> out, joint; inputs type: Int32, origin: Plane, axis: Vector3d; same code as joint

supported_types_5 = ValueList({"REVOLUTE": 0, "CONTINUOUS": 1, "PRISMATIC": 2, "FIXED": 3, "FLOATING": 4, "PLANAR": 5}, selected="REVOLUTE")
curve_5 = Curve(<curve referenced from the Rhino model>)
orient_4 = Orient(Geometry=curve_5, Source=xy_plane_2, Target=PlaneXY(0, 0, 0))  # -> Geometry, Transform
radians_9 = Radians(Degrees=Slider(270, range=0..1000))
radians_10 = Radians(Degrees=Slider(-270, range=-1000..1000))
end_points_5 = EndPoints(Curve=orient_4.Geometry)  # -> Start, End
vector_2pt_5 = Vector2Pt(PointA=end_points_5.Start, PointB=end_points_5.End, Unitize=False)  # -> Vector, Length
joint_5 = GhPythonScript(
    name="joint_6",
    type=supported_types_5,
    origin=end_points_5.Start,
    axis=vector_2pt_5.Vector,
    parent_link=link_2.link,
    child_link=link.link,
    lower_limit=radians_10,
    upper_limit=radians_9)  # -> out, joint; inputs type: Int32, origin: Plane, axis: Vector3d; same code as joint

supported_types_6 = ValueList({"REVOLUTE": 0, "CONTINUOUS": 1, "PRISMATIC": 2, "FIXED": 3, "FLOATING": 4, "PLANAR": 5}, selected="REVOLUTE")
curve_6 = Curve(<curve referenced from the Rhino model>)
orient_5 = Orient(Geometry=curve_6, Source=xy_plane_5, Target=PlaneXY(0, 0, 0))  # -> Geometry, Transform
radians_11 = Radians(Degrees=Slider(85, range=0..1000))
radians_12 = Radians(Degrees=Slider(-225, range=-1000..1000))
end_points_6 = EndPoints(Curve=orient_5.Geometry)  # -> Start, End
vector_2pt_6 = Vector2Pt(PointA=end_points_6.Start, PointB=end_points_6.End, Unitize=False)  # -> Vector, Length
joint_6 = GhPythonScript(
    name="joint_3",
    type=supported_types_6,
    origin=end_points_6.Start,
    axis=vector_2pt_6.Vector,
    parent_link=link_6.link,
    child_link=link_3.link,
    lower_limit=radians_12,
    upper_limit=radians_11)  # -> out, joint; inputs type: Int32, origin: Plane, axis: Vector3d; same code as joint

robotmodel = GhPythonScript(
    name="crb15000_10kg",
    joints=[joint.joint, joint_2.joint, joint_6.joint, joint_4.joint, joint_3.joint, joint_5.joint],
    links=[link_4.link, link_5.link, link_6.link, link_3.link, link_7.link, link_2.link, link.link])  # -> out, robot_model; inputs joints: list, links: list
# ---------- robotmodel: Python ----------
__author__ = "leungp"
__version__ = "2024.10.10"

import rhinoscriptsyntax as rs
from compas_robots import RobotModel

# The following check is essential to ensure a properly formed RobotModel object
# Otherwise the subsequent Scene operation can create infinite loops that crashes.

assert len(joints) + 1 == len(links)

links_dict={}
for link in links:
    assert link.name not in links_dict
    links_dict[link.name] = [None, []]

for joint in joints:
    if str(joint.parent) not in links_dict:
        print ("Parent Link '{}' for Joint {} missing".format(joint.parent, joint.name))
        assert False
    if str(joint.child) not in links_dict:
        print ("Child Link '{}' for Joint {} missing".format(joint.child, joint.name))
        assert False
    links_dict[str(joint.parent)][1].append(str(joint.child))
    links_dict[str(joint.child)][0] = str(joint.parent)

no_parent = [l[0] is None for l in links_dict.values()]
assert sum(no_parent) == 1

robot_model = RobotModel(name, joints, links)
# ---------- end robotmodel ----------
planning_group = GhPythonScript(name="manipulator", joints=[joint.joint, joint_2.joint, joint_6.joint, joint_4.joint, joint_3.joint, joint_5.joint])  # -> out, group; inputs joints: list, links: list
# ---------- planning_group: Python ----------
group_joints = []
group_links = []

class Group:
    def __init__(self, name, joints, links):
        self.name = name
        self.joints = joints
        self.links = links

for joint in joints:
    group_joints.append(joint.name)
    link = joint.child.link
    link_name = link.name if hasattr(link, 'name') else str(link)
    group_links.append(link_name)

for link in links:
    link_name = link.name if hasattr(link, 'name') else str(link)
    group_links.append(link_name)
    
group = Group(name, list(set(group_joints)), list(set(group_links)))

print (group.joints)
print (group_joints)
print (group.links)
# ---------- end planning_group ----------
point_8 = Point(<point referenced from the Rhino model>)
semantics = GhPythonScript(Robot_model=robotmodel.robot_model, Groups=planning_group.group)  # -> Out, A
xy_plane_7 = XYPlane(Origin=point_8)
panel = Panel(robotmodel.robot_model)
ghpython_script = GhPythonScript(robot_model=robotmodel.robot_model, tcf=xy_plane_7)  # -> out, tool_model; inputs tcf: Plane
# ---------- ghpython_script: Python ----------
__author__ = "leungp"
__version__ = "2024.10.11"

import rhinoscriptsyntax as rs
from compas_robots import ToolModel

from compas_rhino.conversions import plane_to_compas_frame

tool_model = ToolModel.from_robot_model(robot_model, plane_to_compas_frame(tcf))
# ---------- end ghpython_script ----------

# ----
# Beware, this can take a while to save. Save the GH file before exporting.
save = Button()
python = GhPythonScript(robot_model=robotmodel.robot_model, output=save)  # -> out, json_path
# ---------- python: Python ----------
from Rhino.RhinoDoc import ActiveDoc
import os
from compas import json_dump
json_path = os.path.split(ActiveDoc.Path)[0] + os.path.sep + robot_model.name +".json"

if output:
    import json
    with open(json_path, 'w') as f:
        json_dump(robot_model, f, pretty=True)
# ---------- end python ----------
tool_model_will_be_saved_to_this_path = Panel(python.json_path)

zero_configuration = GhPythonScript(robot_model=robotmodel.robot_model)  # -> out, zero_configuration
# ---------- zero_configuration: Python ----------
zero_configuration = robot_model.zero_configuration()
# ---------- end zero_configuration ----------

panel_2 = Panel("""-45
45""")
panel_3 = Panel("""-20
20""")
panel_4 = Panel("""-90
25""")
panel_5 = Panel("""-50
40""")
panel_6 = Panel("""-50
50""")
# Configurations for testing
panel_7 = Panel("""-40
0
40""")
radians_13 = Radians(Degrees=panel_3)
radians_14 = Radians(Degrees=panel_2)
radians_15 = Radians(Degrees=panel_4)
radians_16 = Radians(Degrees=panel_5)
radians_17 = Radians(Degrees=panel_6)
radians_18 = Radians(Degrees=panel_7)
cross_reference = CrossReference(
    ListListA=radians_18,
    ListListB=radians_16,
    ListA=radians_15,
    ListB=radians_17,
    ListC=radians_14,
    ListD=radians_13,
    CrossMode=1)  # -> ListListA, ListListB, ListA, ListB, ListC, ListD
ghpython_script_2 = GhPythonScript(
    configuration=zero_configuration.zero_configuration,
    value_0=cross_reference.ListListA,
    value_1=cross_reference.ListListB,
    value_2=cross_reference.ListA,
    value_3=cross_reference.ListB,
    value_4=cross_reference.ListC,
    value_5=cross_reference.ListD)  # -> out, configuration_out
# ---------- ghpython_script_2: Python ----------
__author__ = "leungp"
__version__ = "2024.10.11"

configuration_out = configuration.copy()
keys = list(configuration_out.keys())

values = [eval("value_"+str(i)) for i in range (6)]
for key, value in zip(keys, values):
    if value:
        configuration_out[key] = value
        print (key, value)
# ---------- end ghpython_script_2 ----------
panel_8 = Panel(cross_reference.ListListA)
ghpython_script_3 = GhPythonScript(configurations=ghpython_script_2.configuration_out, save=Button())  # -> out, a; inputs configurations: list
# ---------- ghpython_script_3: Python ----------
from Rhino.RhinoDoc import ActiveDoc
from compas.data import json_dump
import os
json_path = os.path.split(ActiveDoc.Path)[0] + os.path.sep + "config_test.json"

if save:
    json_dump(configurations, json_path, pretty=True)
# ---------- end ghpython_script_3 ----------
list_item = ListItem(List=ghpython_script_2.configuration_out, Index=Slider(12, range=0..100), Wrap=False)

scene_object = GhPythonScript(robot_model=robotmodel.robot_model)  # -> out, scene_object
# ---------- scene_object: Python ----------
__author__ = "leungp"
__version__ = "2024.10.11"

from compas.scene import SceneObject
try:
    scene_object = SceneObject(item=robot_model)
except:
    pass
# ---------- end scene_object ----------
ghpython_script_4 = GhPythonScript(
    configuration=zero_configuration.zero_configuration,
    value_0=Slider(0.544, range=-4..4),
    value_1=Slider(0.937, range=-4..4),
    value_2=Slider(0.083, range=-4..4),
    value_3=Slider(-1.428, range=-4..4),
    value_4=Slider(0.476, range=-4..4),
    value_5=Slider(-1.156, range=-4..4))  # -> out, configuration_out; same code as ghpython_script_2
robotmodelsceneobjectupdate = GhPythonScript(scene_object=scene_object.scene_object, configuration=list_item)  # -> out, meshes, frames
# ---------- robotmodelsceneobjectupdate: Python ----------
__author__ = "leungp"
__version__ = "2024.10.11"
from compas_rhino.conversions import frame_to_rhino_plane


scene_object.update(configuration)
meshes = scene_object.draw()
#print ()
frames = [frame_to_rhino_plane(f) for f in scene_object.item.frames]
# ---------- end robotmodelsceneobjectupdate ----------

robotlibrary_ur5 = GhPythonScript()  # -> out, robot, robot_model, semantics; disabled
# ---------- robotlibrary_ur5: Python ----------
from compas_fab.robots import RobotLibrary

robot = RobotLibrary.ur5()
robot_model = robot.model
semantics = robot.semantics
# ---------- end robotlibrary_ur5 ----------
ghpython_script_5 = GhPythonScript(semantics=robotlibrary_ur5.semantics)  # -> out, json; disabled
# ---------- ghpython_script_5: Python ----------
json = semantics.to_jsonstring(pretty=True)
# ---------- end ghpython_script_5 ----------
panel_9 = Panel(ghpython_script_5.json)  # disabled

unit_y = UnitY(Factor=Slider(2, range=0..10))
move = Move(Geometry=robotmodelsceneobjectupdate.meshes, Motion=unit_y)  # -> Geometry, Transform
